# Grasshopper definition saif_def.gh (Grasshopper 1.0.7)
# Spherical spikey thing

length = GetNumber(Slider(9.3, range=0..10), AtLeast=1, AtMost=1, Maximum=1.797693135e+308, Minimum=-1.797693135e+308, TreeAccess=False)
count = GetInteger(Slider(8, range=0..10), AtLeast=1, AtMost=1, Maximum=2147483647, Minimum=-2147483648, TreeAccess=False)
radius = GetNumber(Slider(0.5, range=0..1), AtLeast=1, AtMost=1, Maximum=1.797693135e+308, Minimum=-1.797693135e+308, TreeAccess=False)
pt = ConstructPoint(XCoordinate=0, YCoordinate=0, ZCoordinate=0)
line = LineSDL(Start=pt, Direction="1,1,1", Length=length)
divide = DivideCurve(Curve=line, Count=count, Kinks=False)  # -> Points, Tangents, Parameters
sph = Sphere(Base=divide.Points, Radius=radius)
subd = SubD(sph)
context_bake = ContextBake(Geometry=subd)
